# Grasshopper definition Documents_Native.ghx (Grasshopper 1.0.7)
# plug-ins: Rhino.Inside for Autodesk Revit

model = ModelCategoriesPicker({"Air Systems": -2001008, "Air Terminals": -2008013, "Analysis Display Style": -2000304, "Analysis Results": -2000303, "Areas": -2003200, "Bridge Abutments": -2006130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}, selected="Walls": -2000011)
documents = AllDocuments()  # -> Projects, Families
documents_2 = AllDocuments()  # -> Projects, Families
documents_3 = AllDocuments()  # -> Projects, Families
documents_4 = AllDocuments()  # -> Projects, Families
active = ActiveDocument()
documents_5 = AllDocuments()  # -> Projects, Families
identity = DocumentIdentity()  # -> Title, IsFamily, UnitSystem
worksharing = DocumentWorksharing(Document=documents_3.Projects)  # -> IsWorkshared, ServerPath, CentralGUID, Detached
file = DocumentFile(Document=documents_4.Projects)  # -> DocumentGUID, PathName, ReadOnly, Modified, NumberOfSaves, VersionGUID
value_set_picker = ValueSetPicker(documents_2.Projects)
panel = Panel(documents.Families)
panel_2 = Panel(documents.Projects)
identity_2 = DocumentIdentity(Document=documents_5.Projects)  # -> Title, IsFamily, UnitSystem
path_mapper = PathMapper([identity.Title, identity.IsFamily, identity.UnitSystem], source="{A}(i)", target="{A;i}")
panel_3 = Panel(active)
bycategory = CategoryFilter(Categories=model, Inverted=False)
documents_6 = AllDocuments()  # -> Projects, Families
path_mapper_2 = PathMapper([identity_2.Title, identity_2.IsFamily, identity_2.UnitSystem], source="{A}(i)", target="{A;i}")
path_mapper_3 = PathMapper(
    [worksharing.IsWorkshared, worksharing.ServerPath, worksharing.CentralGUID, worksharing.Detached],
    source="{A}(i)",
    target="{A;i}")
panel_4 = Panel(path_mapper)
path_mapper_4 = PathMapper(
    [file.DocumentGUID, file.PathName, file.ReadOnly, file.Modified, file.NumberOfSaves, file.VersionGUID],
    source="{A}(i)",
    target="{A;i}")
elements = QueryElements(Document=documents_6.Projects, Filter=bycategory)
toggle = BooleanToggle(True)
# = Is Workshared?
# = Server Path
# = Worksharing GUID
# = Is Detached?
panel_5 = Panel(path_mapper_3)
# = Document Title
# = Is it a Family Document?
# = Document Unit System
# = Document Title
# = Is it a Family Document?
# = Document Unit System
panel_6 = Panel(path_mapper_2)
# = Document GUID
# = Path
# = Read Only?
# = Modified?
# = Number of Saves
# = Version GUID
panel_7 = Panel(path_mapper_4)
panel_8 = Panel(elements)
save = SaveDocument(Document=value_set_picker, Path="C:\Users\ehsan\Desktop\TestSave2.rvt", OverrideFile=toggle, Compact=toggle, Backups=-1)
panel_9 = Panel(save)
