# Grasshopper definition Walls_Native.ghx (Grasshopper 1.0.7)
# plug-ins: Rhino.Inside for Autodesk Revit

wall_system_family = WallSystemFamily({"Basic": 0, "Curtain": 1, "Stacked": 2}, selected="Basic")
model = ModelCategoriesPicker({"Air Systems": -2001008, "Air Terminals": -2008013, "Analysis Display Style": -2000304, "Analysis Results": -2000303, "Areas": -2003200, "Bridge Abutments": -2006130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}, selected="Walls": -2000011)
# WALLS
model_2 = ModelCategoriesPicker({"Air Systems": -2001008, "Air Terminals": -2008013, "Analysis Display Style": -2000304, "Analysis Results": -2000303, "Areas": -2003200, "Bridge Abutments": -2006130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}, selected="Walls": -2000011)
model_3 = ModelCategoriesPicker({"Air Systems": -2001008, "Air Terminals": -2008013, "Analysis Display Style": -2000304, "Analysis Results": -2000303, "Areas": -2003200, "Bridge Abutments": -2006130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}, selected="Walls": -2000011)
model_4 = ModelCategoriesPicker({"Air Systems": -2001008, "Air Terminals": -2008013, "Analysis Display Style": -2000304, "Analysis Results": -2000303, "Areas": -2003200, "Bridge Abutments": -2006130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}, selected="Walls": -2000011)
model_5 = ModelCategoriesPicker({"Air Systems": -2001008, "Air Terminals": -2008013, "Analysis Display Style": -2000304, "Analysis Results": -2000303, "Areas": -2003200, "Bridge Abutments": -2006130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}, selected="Walls": -2000011)
wall_system_family_2 = WallSystemFamily({"Basic": 0, "Curtain": 1, "Stacked": 2}, selected=["Basic", "Curtain", "Stacked"])
wall_system_family_3 = WallSystemFamily({"Basic": 0, "Curtain": 1, "Stacked": 2}, selected=["Basic", "Curtain", "Stacked"])
model_6 = ModelCategoriesPicker({"Air Systems": -2001008, "Air Terminals": -2008013, "Analysis Display Style": -2000304, "Analysis Results": -2000303, "Areas": -2003200, "Bridge Abutments": -2006130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}, selected="Walls": -2000011)
model_7 = ModelCategoriesPicker({"Air Systems": -2001008, "Air Terminals": -2008013, "Analysis Display Style": -2000304, "Analysis Results": -2000303, "Areas": -2003200, "Bridge Abutments": -2006130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}, selected="Walls": -2000011)
walls = DocumentWalls(WallSystemFamily=wall_system_family)
bycategory = ElementCategoryFilter(Categories=model, Inverted=False)
elementtype_byname = ElementTypeByName(
    model_4,
    {"Basic Wall : # Template": 291958, "Basic Wall : # Template - 1HR Fire Barrier": 598418, "Basic Wall : My Basic Wall": 2224619, "Curtain Wall : # Template": 234927, "Curtain Wall : # Template (Solid)": 1363725, "Curtain Wall : # Template Grid No Mullion": 1362955, "Curtain Wall : # Template Grid Rectangular": 1362748, "Curtain Wall : Grid Butt-Join": 1369832, "Curtain Wall : My Curtain Wall": 1364461}, selected="Curtain Wall : My Curtain Wall")
walls_2 = DocumentWalls(WallSystemFamily=wall_system_family_2)
walls_3 = DocumentWalls(WallSystemFamily=wall_system_family_3)
bycategory_2 = ElementCategoryFilter(Categories=model_2, Inverted=False)
bycategory_3 = ElementCategoryFilter(Categories=model_5, Inverted=False)
bycategory_4 = ElementCategoryFilter(Categories=model_3, Inverted=False)
bycategory_5 = ElementCategoryFilter(Categories=model_6, Inverted=False)
level_of_detail = ValueList({"Coarse": 1, "Medium": 2, "Fine": 3}, selected="Fine")
wall_instances = Panel(walls)
element_identity = ElementIdentity(Element=walls)  # -> Category, Type, Name
elements = DocumentElements(Filter=bycategory)
elements_2 = DocumentElements(Filter=bycategory_3)
elements_3 = QueryElements(Filter=bycategory_2)
types = QueryTypes(Filter=bycategory_4)
bycategory_6 = ElementCategoryFilter(Categories=model_7, Inverted=False)
elements_4 = DocumentElements(Filter=bycategory_5)
crv = Curve(walls_2)
crv_2 = Curve(walls_3)
wall_types = Panel(element_identity.Type)
elements_5 = DocumentElements(Filter=bycategory_6)
panel = Panel(types)
geometry = ElementGeometry(DetailLevel=level_of_detail, Elements=elements)
end = EndPoints(Curve=crv)  # -> Start, End
panel_2 = Panel(elements_3)
analyze_wall = AnalyzeWall(Wall=elements_2)  # -> WallSystemFamily, WallType, ParentStackedWall, BaseLevel, BaseLevelOffset, BottomIsAttached, TopLevel, TopLevelOffset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
center_curve = Panel(crv_2)
bytype = ElementTypeFilter(Types=elementtype_byname, Inverted=False)
panel_3 = Panel(geometry)
analyze_wall_2 = AnalyzeWall(Wall=elements_4)  # -> WallSystemFamily, WallType, ParentStackedWall, BaseLevel, BaseLevelOffset, BottomIsAttached, TopLevel, TopLevelOffset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

# ---- group: Get Wall Start Point
crv_3 = Curve(elements_5)
end_2 = EndPoints(Curve=crv_3)  # -> Start, End

# ----
start_points = Panel(end.Start)
elements_6 = QueryElements(Filter=bytype)
end_points = Panel(end.End)
analyze_wall_3 = AnalyzeWall(Wall=elements_5)  # -> WallSystemFamily, WallType, ParentStackedWall, BaseLevel, BaseLevelOffset, BottomIsAttached, TopLevel, TopLevelOffset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
path_mapper = PathMapper(
    [analyze_wall.WallSystemFamily, analyze_wall.WallType, analyze_wall.ParentStackedWall, analyze_wall.BaseLevel, analyze_wall.BaseLevelOffset, analyze_wall.BottomIsAttached, analyze_wall.TopLevel, analyze_wall.TopLevelOffset, analyze_wall.TopIsAttached, analyze_wall.Height, analyze_wall.Length, analyze_wall.Width, analyze_wall.SlantAngle, analyze_wall.Area, analyze_wall.Volume, analyze_wall.IsRoomBounding, analyze_wall.Structural, analyze_wall.StructuralUsage, analyze_wall.Orientation],
    source="{A;B}(i)",
    target="{A;B;i}")
wsu = WallStructuralUsage({"Non-Bearing": 0, "Bearing": 1, "Shear": 2, "Combined": 3}, selected="Shear")
panel_4 = Panel(elements_6)
scale_vector = Multiplication(A=analyze_wall_3.Orientation, B=2)
panel_5 = Panel(path_mapper)
equals = Equality(FirstNumber=analyze_wall_2.StructuralUsage, SecondNumber=wsu)  # -> Equality, Inequality
wall_orientation_vector = VectorDisplayEx(Point=end_2.Start, Vector=scale_vector, Colour=ColourSwatch(SwatchColor=RGB(255, 255, 0)), Width=2)
cull = CullPattern(List=elements_4, CullPattern=equals.Equality)
panel_6 = Panel(cull)
wsu_2 = WallStructuralUsage({"Non-Bearing": 0, "Bearing": 1, "Shear": 2, "Combined": 3}, selected="Non-Bearing")
# = Wall System Family
# = Wall Type
# = Parent Stacked Wall
# = Base Level (Constraint)
# = Base Offset
# = Is Base Attached?
# = Top Level  (Constraint)
# = Top Offset
# = Is Top Attached?
# = Height
# = Length
# = Width
# = Slant Angle
# = Area
# = Volume
# = Room Bounding
# = Structural?
# = Structural Usage
# = Orientation Vector
wsf = WallSystemFamily({"Basic": 0, "Curtain": 1, "Stacked": 2}, selected="Basic")
wall_system_family_4 = WallSystemFamily({"Basic": 0, "Curtain": 1, "Stacked": 2}, selected="Basic")
wall_system_family_5 = WallSystemFamily({"Basic": 0, "Curtain": 1, "Stacked": 2}, selected="Basic")
wall_system_family_6 = WallSystemFamily({"Basic": 0, "Curtain": 1, "Stacked": 2}, selected="Basic")
wall_system_family_7 = WallSystemFamily({"Basic": 0, "Curtain": 1, "Stacked": 2}, selected="Basic")
wall_system_family_8 = WallSystemFamily({"Basic": 0, "Curtain": 1, "Stacked": 2}, selected="Basic")
wall_system_family_9 = WallSystemFamily({"Basic": 0, "Curtain": 1, "Stacked": 2}, selected="Basic")
wall_system_family_10 = WallSystemFamily({"Basic": 0, "Curtain": 1, "Stacked": 2}, selected="Basic")
# BASIC WALLS
wall_system_family_11 = WallSystemFamily({"Basic": 0, "Curtain": 1, "Stacked": 2}, selected="Basic")
wall_system_family_12 = WallSystemFamily({"Basic": 0, "Curtain": 1, "Stacked": 2}, selected="Stacked")
walls_4 = DocumentWalls(WallSystemFamily=wall_system_family_4)
walls_5 = DocumentWalls(WallSystemFamily=wall_system_family_5)
walls_6 = DocumentWalls(WallSystemFamily=wall_system_family_6)
walls_7 = DocumentWalls(WallSystemFamily=wall_system_family_7)
walls_8 = DocumentWalls(WallSystemFamily=wall_system_family_10)
walls_9 = DocumentWalls(WallSystemFamily=wall_system_family_8)
walls_10 = DocumentWalls(WallSystemFamily=wall_system_family_9)
identity = ElementIdentity(Element=walls_4)  # -> Category, Type, Name
identity_2 = ElementIdentity(Element=walls_5)  # -> Category, Type, Name
walls_11 = DocumentWalls(WallSystemFamily=wall_system_family_12)
walls_12 = DocumentWalls(WallSystemFamily=wall_system_family_11)
identity_3 = ElementIdentity(Element=walls_6)  # -> Category, Type, Name
identity_4 = ElementIdentity(Element=walls_7)  # -> Category, Type, Name
identity_5 = ElementIdentity(Element=walls_9)  # -> Category, Type, Name
identity_6 = ElementIdentity(Element=walls_10)  # -> Category, Type, Name
identity_7 = ElementIdentity(Element=walls_8)  # -> Category, Type, Name
a_bwt = AnalyzeBasicWallType(BasicWallType=identity_2.Type)  # -> Structure, WrappingAtInserts, WrappingAtEnds, Width, Function
a_bwt_2 = AnalyzeBasicWallType(BasicWallType=identity_3.Type)  # -> Structure, WrappingAtInserts, WrappingAtEnds, Width, Function
a_bwt_3 = AnalyzeBasicWallType(BasicWallType=identity_4.Type)  # -> Structure, WrappingAtInserts, WrappingAtEnds, Width, Function
csg = ElementCompoundStructureGeometry(Element=walls_12)
csg_2 = ElementCompoundStructureGeometry(Element=walls_11)
wr = WallWrapping({"Do Not Wrap": 0, "Exterior": 1, "Interior": 2, "Both": 3}, selected="Do Not Wrap")
a_bwt_4 = AnalyzeBasicWallType(BasicWallType=identity_5.Type)  # -> Structure, WrappingAtInserts, WrappingAtEnds, Width, Function
wf = WallFunction({"Interior": 0, "Exterior": 1, "Foundation": 2, "Retaining": 3, "Soffit": 4, "Core-Shaft": 5}, selected="Exterior")
a_bwt_5 = AnalyzeBasicWallType(BasicWallType=identity_7.Type)  # -> Structure, WrappingAtInserts, WrappingAtEnds, Width, Function
a_bwt_6 = AnalyzeBasicWallType(BasicWallType=identity.Type)  # -> Structure, WrappingAtInserts, WrappingAtEnds, Width, Function
a_bwt_7 = AnalyzeBasicWallType(BasicWallType=identity_6.Type)  # -> Structure, WrappingAtInserts, WrappingAtEnds, Width, Function
# ▼ Exterior
# ▲ Interior
panel_7 = Panel(csg)
panel_8 = Panel(csg_2)
dcs = DeconstructCompoundStructure(CompoundStructure=a_bwt.Structure)  # -> TotalThickness, SampleHeight, CutoffHeight, MinimumSampleHeight, MinimumLayerThickness, Layers, FirstCoreLayerIndex, LastCoreLayerIndex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
dcs_2 = DeconstructCompoundStructure(CompoundStructure=a_bwt_2.Structure)  # -> TotalThickness, SampleHeight, CutoffHeight, MinimumSampleHeight, MinimumLayerThickness, Layers, FirstCoreLayerIndex, LastCoreLayerIndex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
dcs_3 = DeconstructCompoundStructure(CompoundStructure=a_bwt_4.Structure)  # -> TotalThickness, SampleHeight, CutoffHeight, MinimumSampleHeight, MinimumLayerThickness, Layers, FirstCoreLayerIndex, LastCoreLayerIndex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
equals_2 = Equality(FirstNumber=a_bwt_5.Function, SecondNumber=wf)  # -> Equality, Inequality
dcs_4 = DeconstructCompoundStructure(CompoundStructure=a_bwt_6.Structure)  # -> TotalThickness, SampleHeight, CutoffHeight, MinimumSampleHeight, MinimumLayerThickness, Layers, FirstCoreLayerIndex, LastCoreLayerIndex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
equals_3 = Equality(FirstNumber=a_bwt_7.WrappingAtInserts, SecondNumber=wr)  # -> Equality, Inequality
wall_structure = Panel(a_bwt_3.Structure)
wall_function = Panel(a_bwt_3.Function)
wall_width = Panel(a_bwt_3.Width)
wrapping_at_inserts = Panel(a_bwt_3.WrappingAtInserts)
wrapping_at_ends = Panel(a_bwt_3.WrappingAtEnds)
cull_2 = CullPattern(List=identity_7.Type, CullPattern=equals_2.Equality)
cull_3 = CullPattern(List=identity_6.Type, CullPattern=equals_3.Equality)
csg_3 = ElementCompoundStructureGeometry(Element=walls_4)
geometry_2 = ElementGeometry(Elements=walls_4)
number_slider = Slider(1, range=0..5)
panel_9 = Panel(cull_2)
panel_10 = Panel(cull_3)
path_mapper_2 = PathMapper(
    [dcs_3.SampleHeight, dcs_3.CutoffHeight, dcs_3.MinimumSampleHeight, dcs_3.MinimumLayerThickness, dcs_3.FirstCoreLayerIndex, dcs_3.LastCoreLayerIndex, dcs_3.StructuralMaterialIndex, dcs_3.VLIDX, dcs_3.WrappingAtInserts, dcs_3.WrappingAtEnds, dcs_3.HasStructuralDeck, dcs_3.IsVerticallyCompound, dcs_3.IsVerticallyHomogeneous],
    source="{A;B}(i)",
    target="{A;B;i}")
preview = CustomPreview(Geometry=geometry_2, Material=ColourSwatch(SwatchColor=RGBA(66, 66, 66, 0)))
total_thickness = Panel(dcs_3.TotalThickness)
structure_layers = Panel(dcs_3.Layers)
item = ListItem(List=dcs.Layers, Index=Slider(2, range=0..6), Wrap=True)
item_2 = ListItem(List=dcs_2.Layers, Index=Slider(2, range=0..6), Wrap=True)
# ▼ Exterior
# ▲ Interior
misc_data = Panel(path_mapper_2)
item_3 = ListItem(List=dcs_4.Layers, Index=number_slider, Wrap=True)
wf_2 = WallFunction({"Interior": 0, "Exterior": 1, "Foundation": 2, "Retaining": 3, "Soffit": 4, "Core-Shaft": 5}, selected="Interior")
item_4 = ListItem(List=csg_3, Index=number_slider, Wrap=True)
wr_2 = WallWrapping({"Do Not Wrap": 0, "Exterior": 1, "Interior": 2, "Both": 3}, selected="Do Not Wrap")
wr_3 = WallWrapping({"Do Not Wrap": 0, "Exterior": 1, "Interior": 2, "Both": 3}, selected="Do Not Wrap")
dcsl = DeconstructCompoundStructureLayer(CompoundStructureLayer=item)  # -> Index, Function, Material, Thickness, Wraps, DeckProfile, DeckEmbeddingType
structure_layer = Panel(item_2)
panel_11 = Panel(item_3)
panel_12 = Panel(item_4)
layer_material = Panel(dcsl.Material)
misc_data_2 = Panel([dcsl.Index, dcsl.Function, dcsl.Thickness, dcsl.Wraps, dcsl.DeckProfile, dcsl.DeckEmbeddingType])
# = Sample Height
# = Cuttoff Hight
# = Min Sample Height
# = Min Layer Thickness
# = First Core Layer Index
# = Last Core Layer Index
# = Structural Material Index
# = Variable Layer Index
# = Wrapping at Inserts
# = Wrapping at Ends
# = Has Structural Deck
# = Is Vertically Compund
# = Is Vertically Homogeneous
owc = OpeningWrappingCondition({"None": 0, "Exterior": 1, "Interior": 2, "Exterior and Interior": 3}, selected="None")
ecc = EndCapCondition({"Exterior": 1, "Interior": 2, "NoEndCap": 3}, selected="Exterior")
# = Layer Id
# = Function
# = Width
# = Wraps
# = Deck Profile Id
# = Deck Embedding Type
lf = LayerFunction({"Structure": 1, "Substrate": 2, "Insulation": 3, "Finish 1": 4, "Finish 2": 5, "Membrane": 100, "StructuralDeck": 200}, selected="Structure")
det = DeckEmbeddingType({"Merge with Layer Above": 0, "Standalone": 1}, selected="Merge with Layer Above")
wall_system_family_13 = WallSystemFamily({"Basic": 0, "Curtain": 1, "Stacked": 2}, selected=["Basic", "Stacked"])
# BASIC WALLS
# AND STACKED WALLS
wall_system_family_14 = WallSystemFamily({"Basic": 0, "Curtain": 1, "Stacked": 2}, selected=["Basic", "Stacked"])
wall_system_family_15 = WallSystemFamily({"Basic": 0, "Curtain": 1, "Stacked": 2}, selected="Stacked")
walls_13 = DocumentWalls(WallSystemFamily=wall_system_family_13)
walls_14 = DocumentWalls(WallSystemFamily=wall_system_family_14)
walls_15 = DocumentWalls(WallSystemFamily=wall_system_family_15)
analyse_wall_profile = AnalyseWallProfile(Wall=walls_13)
wll = WallLocationLine({"Wall Centerline": 0, "Core Centerline": 1, "Finish (Exterior Face)": 2, "Finish (Interior Face)": 3, "Core (Exterior Face)": 4, "Core (Interior Face)": 5}, selected="Core (Exterior Face)")
a_wlc = AnalyseWallLocationCurve(Wall=walls_14)  # -> LocationLine, CenterCurve, LocationCurve, OffsetValue
a_wlc_2 = AnalyseWallLocationCurve(Wall=walls_15)  # -> LocationLine, CenterCurve, LocationCurve, OffsetValue
panel_13 = Panel(analyse_wall_profile)
location_line = Panel(a_wlc.LocationLine)
center_curve_2 = Panel(a_wlc.CenterCurve)
location_line_curve = Panel(a_wlc.LocationCurve)
location_line_offset = Panel(a_wlc.OffsetValue)
equals_4 = Equality(FirstNumber=a_wlc_2.LocationLine, SecondNumber=wll)  # -> Equality, Inequality
cull_4 = CullPattern(List=walls_15, CullPattern=equals_4.Equality)
panel_14 = Panel(cull_4)
wll_2 = WallLocationLine({"Wall Centerline": 0, "Core Centerline": 1, "Finish (Exterior Face)": 2, "Finish (Interior Face)": 3, "Core (Exterior Face)": 4, "Core (Interior Face)": 5}, selected="Wall Centerline")
wall_system_family_16 = WallSystemFamily({"Basic": 0, "Curtain": 1, "Stacked": 2}, selected="Basic")
wall_system_family_17 = WallSystemFamily({"Basic": 0, "Curtain": 1, "Stacked": 2}, selected="Stacked")
# STACKED WALLS
wall_system_family_18 = WallSystemFamily({"Basic": 0, "Curtain": 1, "Stacked": 2}, selected="Stacked")
walls_16 = DocumentWalls(WallSystemFamily=wall_system_family_16)
walls_17 = DocumentWalls(WallSystemFamily=wall_system_family_17)
analyse_stacked_wall = AnalyseStackedWall(StackedWall=walls_17)
walls_18 = DocumentWalls(WallSystemFamily=wall_system_family_18)
analyse_stacked_wall_2 = AnalyseStackedWall(StackedWall=walls_18)
entwine = Entwine(Branch0X=walls_16, Branch1X=analyse_stacked_wall, FlattenInputs=False)
simplify = SimplifyTree(Tree=entwine, Front=False)
panel_15 = Panel(analyse_stacked_wall_2)
csg_4 = ElementCompoundStructureGeometry(Element=simplify)
# ▼ Exterior
# ▲ Interior
panel_16 = Panel(csg_4)
# BOUNDING GEOM
wall_system_family_19 = WallSystemFamily({"Basic": 0, "Curtain": 1, "Stacked": 2}, selected=["Basic", "Curtain", "Stacked"])
walls_19 = DocumentWalls(WallSystemFamily=wall_system_family_19)
ebg = ElementBoundingGeometry(Element=walls_19)
