# Grasshopper definition rir-csharp.ghx (Grasshopper 1.0.7)

c_script = CSharpScript(
    Radius=Slider(10, range=10..11),
    Trigger=Toggle(True),
    Reference=["C:\Program Files\Autodesk\Revit 2020\RevitAPI.dll", "C:\Program Files\Autodesk\Revit 2020\RevitAPIUI.dll", "C:\Users\ehsan\AppData\Roaming\Autodesk\Revit\Addins\2020\RhinoInside.Revit\RhinoInside.Revit.dll"])  # -> out, Sphere
# ---------- c_script: C# usings ----------
using RIR = RhinoInside.Revit;
using DB = Autodesk.Revit.DB;
using UI = Autodesk.Revit.UI;
using RhinoInside.Revit.Convert.Geometry;
# ---------- c_script: C# ----------
    _sphere = new Rhino.Geometry.Sphere(Rhino.Geometry.Point3d.Origin, (double) Radius);
    if ((bool) Trigger) {
      RIR.Revit.EnqueueAction(CreateGeometry);
    }

    Sphere = _sphere;
# ---------- c_script: C# additional code ----------
  private Rhino.Geometry.Sphere _sphere;

  private void CreateGeometry(DB.Document doc) {
    // convert the sphere into Brep
    var brep = _sphere.ToBrep();

    // now let's pick the Generic Model category for
    // our baked geometry in Revit
    var revitCategory = new DB.ElementId((int) DB.BuiltInCategory.OST_GenericModel);

    // Finally we can create a DirectShape using Revit API
    // inside the Revit document and add the sphere mesh
    // to the DirectShape
    var ds = DB.DirectShape.CreateElement(doc, revitCategory);
    var shapeList = new List<DB.GeometryObject>() { brep.ToSolid() };
    ds.AppendShape(shapeList);
  }

  /// <summary>
  /// This method will be called once every solution, before any calls to RunScript.
  /// </summary>
  public override void BeforeRunScript()
  { }
  /// <summary>
  /// This method will be called once every solution, after any calls to RunScript.
  /// </summary>
  public override void AfterRunScript()
  { }
# ---------- end c_script ----------
panel = Panel(c_script.Sphere)
